# Grasshopper definition 3d-Printing-robotic-arm-visualiser.gh (Grasshopper 1.0.7)
# plug-ins: Pufferfish, Robots, Human, Weaverbird, MeshEdit Components

# ---- group: INPUT GEOMETRY
# 1. INPUT SHAPE
brep = Brep(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)

# ---- group: INITIAL CALIBRATION
layer_height = Slider(45, range=-10..50)
y_calibration = Slider(0, range=-1000..1000)
angle = Slider(180, range=-180..180)
calibration_points = Point([Point(1108.272594, 235.5787767, 0), Point(1108.272594, -337.2908874, 0), Point(535.4029303, 235.5787767, 0), Point(530.4779482, -337.2908874, 0)])
x_calibration = Slider(0, range=-1000..1000)

# ---- group: PARAMETERS
layer_height_2 = Slider(3, range=0.01..15)
layer_count = Slider(1, range=1..100)
target_density = Slider(5, range=0..100)
nozzle_diameter = Slider(6, range=0..10)

# ----
# ROBOT SYSTEM
list = RobotsLibrary(
    {"Franka Emika Panda", "Bartlett-IRB120", "Bartlett-IRB1600", "Bartlett-KR6", "Bartlett-KR60-A", "Bartlett-KR60-B", "Bartlett-KR500", "Bartlett-KR60 on track", "Bartlett-UR10", "Bartlett-KR60", "Bartlett-TX200", "Bartlett-TX200L", "Bartlett-RX160", "Bartlett-RX160L", "CITA-IRB1600-145 + Turntable", "CITA-IRB1600-145 + IRB140", "CITA-IRB1600-145", "CITA-IRB140", "CITA-UR5e"}, selected="Bartlett-UR10",
    Type=0)
xy = XYPlane(Origin=Point(0, 0, 0))
loadrobot = LoadRobotSystem(Name=list, Base=xy)

# ----
# TOOLING
panel = Panel("-15")
tool_mesh = Mesh(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)
tcp = ConstructPoint(XCoordinate="0.00003", YCoordinate="-90", ZCoordinate="30")
center_of_gravity = ConstructPoint(XCoordinate=panel, YCoordinate="30", ZCoordinate="30")
xz = XZPlane(Origin=tcp)
weight = Panel("0.5")
tool = CreateTool(Name="DefaultGHTool", TCP=xz, Weight=weight, Centroid=center_of_gravity, Mesh=tool_mesh)  # -> Tool, TCP

# ----
# START
O = Origin(Point(636.6660387, 125.3319395, 346.9591253))
yz = YZPlane(Origin=O)
deplane = DeconstructPlane(Plane=yz)  # -> Origin, XAxis, YAxis, ZAxis
setdo = SetDO(DO="0", Value=Toggle(True))
stop = StopProgram()
rot3d = Rotate3D(Geometry=yz, Angle=degrees(Slider(90, range=0..360)), Center=deplane.Origin, Axis=deplane.YAxis)  # -> Geometry, Transform
K = Kinematics(RobotSystem=loadrobot, Target=rot3d.Geometry, DisplayGeometry=True)  # -> Meshes, Joints, Planes, Errors
speed = CreateSpeed(
    Translation=Slider(500, range=1..500),
    Rotation=3.141592654,
    ExternalTranslation=5000,
    ExternalRotation=18.84955592,
    AccelTranslation=2500,
    AccelAxis=12.56637061)
groupcmd = GroupCommand(Commands=[stop, setdo])
target = CreateTarget(Joints=K.Joints, Tool=tool.Tool, Speed=speed, Zone=Slider(0.5, range=0.01..5), Command=groupcmd, IsCartesian=False)

# ---- group: ANIMATE TIMER
# ANIMATE SLIDER
timer_0_1 = Slider(0, range=0..1)

# ----
panel_2 = Panel("Neue Pixel Grotesk")  # disabled

# ---- group: 0 point location
num = Number(153.8352745)  # disabled
num_2 = Number(258.4438223)  # disabled
num_3 = Number(636.6660097)  # disabled

# ----
# 2. CONSTRUCT PRINTING PATH
contour = Contour(Shape=brep, Point=Point(0, 0, 0), Direction=Vector(0, 0, 1), Distance=Slider(4, range=0..10))  # -> simplify(Contours)
number_slider = Slider(16, range=0..100)
xy_plane = XYPlane(Origin=Point(0, 0, 0))
geometry = Geometry(contour)
offset_curve = OffsetCurve(Curve=geometry, Distance=expr("-x", number_slider), Plane=xy_plane, Corners=1)
offset_curve_2 = OffsetCurve(Curve=geometry, Distance=number_slider, Plane=xy_plane, Corners=1)
number_slider_2 = Slider(10, range=0..10)
number_slider_3 = Slider(30, range=0..100)
number_slider_4 = Slider(5, range=0..10)
divide_distance = DivideDistance(Curve=geometry, Distance=number_slider_3)  # -> Points, Tangents, Parameters
fillet = Fillet(Curve=offset_curve_2, Radius=number_slider_2)
fillet_2 = Fillet(Curve=offset_curve, Radius=number_slider_2)
explode = Explode(Curve=fillet_2, Recursive=True)  # -> Segments, Vertices
subtraction = Subtraction(A=number_slider, B=number_slider_4)
cull = CullPattern(List=explode.Segments, CullPattern=[False, True])
cull_index = CullIndex(List=divide_distance.Points, Indices="-1", Wrap=True)
offset_curve_3 = OffsetCurve(Curve=fillet, Distance=expr("X*-1", number_slider_4), Plane=xy_plane, Corners=1)
offset_curve_4 = OffsetCurve(Curve=cull, Distance=number_slider_4, Plane=xy_plane, Corners=1)
offset_curve_5 = OffsetCurve(Curve=offset_curve_4, Distance=expr("X*2", subtraction), Plane=xy_plane, Corners=1)
len = Length(Curve=offset_curve_4)
division = Division(A=len, B=number_slider_3)
round = Round(Number=division)  # -> Nearest, Floor, Ceiling
tweencrv = TweenCurve(CurveA=offset_curve_5, CurveB=offset_curve_4, Factor=0.5, BlendType=0)
number_slider_5 = Slider(18, range=0..100)
explode_2 = Explode(Curve=offset_curve_3, Recursive=True)  # -> Segments, Vertices
cull_2 = CullPattern(List=explode_2.Segments, CullPattern=[False, True])  # -> graft(List)
end = EndPoints(Curve=cull_2)  # -> Start, End
trim = TrimTree(Tree=simplify(end.Start), Depth=1)
trim_2 = TrimTree(Tree=simplify(end.End), Depth=1)
shift = ShiftList(List=trim_2, Shift=-1, Wrap=True)
ln = Line(StartPoint=trim, EndPoint=shift)  # -> simplify(Line)

oddevenums = OddEvenNumbers(Numbers=round.Nearest, Placeholders=True)  # -> Odd, Even
clean = CleanTree(RemoveNulls=True, RemoveInvalid=True, RemoveEmpty=False, Tree=oddevenums.Even)
clean_2 = CleanTree(RemoveNulls=True, RemoveInvalid=True, RemoveEmpty=False, Tree=oddevenums.Odd)
addition = Addition(A=clean_2, B="1")
null = NullItem(Item=oddevenums.Odd)  # -> NullFlags, InvalidFlags, Description
weave = Weave(Pattern=null.NullFlags, Stream0=addition, Stream1=clean, NullGaps=False)
panel_3 = Panel(weave)

divide = DivideCurve(Curve=tweencrv, Count=expr("x+1", panel_3), Kinks=False)  # -> Points, Tangents, Parameters
crv_cp = CurveClosestPoint(Point=divide.Points, Curve=graft(offset_curve_5))  # -> Point, Parameter, Distance
crv_cp_2 = CurveClosestPoint(Point=divide.Points, Curve=graft(offset_curve_4))  # -> Point, Parameter, Distance
shatter = Shatter(Curve=graft(offset_curve_5), Parameters=crv_cp.Parameter)
shatter_2 = Shatter(Curve=graft(offset_curve_4), Parameters=crv_cp_2.Parameter)
cull_3 = CullPattern(List=shatter_2, CullPattern=invert([False, True]))
cull_4 = CullPattern(List=shatter, CullPattern=[False, True])

crv = Curve(cull_4)
curvepoint = PointOnCurve(crv, parameter=0.5)
amp = Amplitude(Vector=crv, Amplitude=expr("x/2", number_slider_5))
move = Move(Geometry=curvepoint, Motion=expr("x*-1", amp))  # -> Geometry, Transform
move_2 = Move(Geometry=curvepoint, Motion=amp)  # -> Geometry, Transform
ln_2 = Line(StartPoint=move_2.Geometry, EndPoint=move.Geometry)

crv_2 = Curve(cull_3)
curvepoint_2 = PointOnCurve(crv_2, parameter=0.5)
amp_2 = Amplitude(Vector=crv_2, Amplitude=expr("x/2", number_slider_5))
move_3 = Move(Geometry=curvepoint_2, Motion=expr("x*-1", amp_2))  # -> Geometry, Transform
move_4 = Move(Geometry=curvepoint_2, Motion=amp_2)  # -> Geometry, Transform
ln_3 = Line(StartPoint=move_4.Geometry, EndPoint=move_3.Geometry)

explode_3 = Explode(Curve=ln_2, Recursive=True)  # -> Segments, simplify(Vertices)
explode_4 = Explode(Curve=ln_3, Recursive=True)  # -> Segments, simplify(Vertices)
trim_3 = TrimTree(Tree=reverse(explode_3.Vertices), Depth=1)
trim_4 = TrimTree(Tree=reverse(explode_4.Vertices), Depth=1)
weave_2 = Weave(Pattern=[0, 0, 1, 1], Stream0=trim_4, Stream1=trim_3, NullGaps=False)
pline = PolyLine(Vertices=weave_2, Closed=False)
end_2 = EndPoints(Curve=pline)  # -> Start, End
ln_4 = Line(StartPoint=end.End, EndPoint=end_2.End)
ln_5 = Line(StartPoint=end.Start, EndPoint=end_2.Start)
merge = Merge(Data1=graft(ln), Data2=simplify(ln_5), Data3=simplify(ln_4), Data4=simplify(pline))
trim_5 = TrimTree(Tree=merge, Depth=1)
join = JoinCurves(Curves=trim_5, Preserve=False)
fillet_3 = Fillet(Curve=join, Radius=Slider(8, range=0..10))  # -> simplify(Curve)
merge_2 = Merge(Data1=simplify([fillet, fillet_2]), Data2=simplify(fillet_3))

# ----
# 3. ADJUST PRINT PARAMETERS
# TOOLPATHS
input_geometry = Geometry(flatten(merge_2))

# ---- group: ADJUST SEAM
seam = Seam(Curve=reparameterize(input_geometry), Seam=Slider(0.5, range=0..1))

# ----
# MODEL ALIGNMENT
bbox = BoundingBox(Content=calibration_points, Plane=PlaneXY(0, 0, 0), UnionBox=True)  # -> Box, Box_2
plfit = PlaneFit(Points=calibration_points)  # -> Plane, Deviation
volume = Volume(Geometry=bbox.Box)  # -> Volume, Centroid
pl_origin = PlaneOrigin(Base=plfit.Plane, Origin=volume.Centroid)
# 4. DEFINE ROBOTIC ARM SETTINGS & TOOLPATH
bbox_2 = BoundingBox(Content=seam, Plane=PlaneXY(0, 0, 0), UnionBox=True)  # -> Box, Box_2
volume_2 = Volume(Geometry=bbox_2.Box)  # -> Volume, Centroid
prot = RotatePlane(Plane=pl_origin, Angle=degrees(angle))
xy_2 = XYPlane(Origin=volume_2.Centroid)
pflip = FlipPlane(Plane=prot, ReverseX=False, ReverseY=False, SwapAxes=True)
Y = UnitY(Factor=y_calibration)
X = UnitX(Factor=x_calibration)
orient = Orient(Geometry=seam, Source=xy_2, Target=pflip)  # -> Geometry, Transform
move_5 = Move(Geometry=orient.Geometry, Motion=X)  # -> Geometry, Transform
move_6 = Move(Geometry=move_5.Geometry, Motion=Y)  # -> Geometry, Transform

# ----
# DENSITY DEFINITION
series = Series(Start=layer_height, Step=layer_height_2, Count=layer_count)
Z = UnitZ(Factor=series)
move_7 = Move(Geometry=graft(move_6.Geometry), Motion=Z)  # -> simplify(Geometry), Transform
divlength = DivideLength(Curve=move_7.Geometry, Length=target_density)  # -> Points, Tangents, Parameters
path_mapper = PathMapper(divlength.Points, source="{A;B}", target="{B}")
planes_do_not_turn_on_preview = XYPlane(Origin=path_mapper)
pflip_2 = FlipPlane(Plane=planes_do_not_turn_on_preview, ReverseX=False, ReverseY=False, SwapAxes=True)  # -> flatten(Plane)

# ----
# END
bbox_3 = BoundingBox(Content=pflip_2, Plane=PlaneXY(0, 0, 0), UnionBox=True)  # -> Box, Box_2
item = ListItem(List=reverse(pflip_2), Index=0, Wrap=True)
volume_3 = Volume(Geometry=bbox_3.Box)  # -> Volume, Centroid
vec2pt = Vector2Pt(PointA=volume_3.Centroid, PointB=item, Unitize=False)  # -> Vector, Length
Z_2 = UnitZ(Factor=Slider(300, range=0..1000))
amp_3 = Amplitude(Vector=vec2pt.Vector, Amplitude=Slider(200, range=0..200))
move_8 = Move(Geometry=item, Motion=amp_3)  # -> Geometry, Transform
move_9 = Move(Geometry=move_8.Geometry, Motion=Z_2)  # -> Geometry, Transform
speed_2 = CreateSpeed(
    Translation=Slider(200, range=1..500),
    Rotation=3.141592654,
    ExternalTranslation=5000,
    ExternalRotation=18.84955592,
    AccelTranslation=2500,
    AccelAxis=12.56637061)
list_2 = FlagFields({"Shoulder": 1, "Elbow": 2, "Wrist": 4}, selected="Wrist")
list_3 = ValueList({"Joint", "Linear"}, selected="Linear")
setdo_2 = SetDO(DO="0", Value=Toggle(False))
target_2 = CreateTarget(
    Plane=move_9.Geometry,
    RobConf=list_2,
    Motion=list_3,
    Tool=tool.Tool,
    Speed=speed_2,
    Zone=Slider(0.5, range=0.01..5),
    Command=setdo_2,
    IsCartesian=True)

# ----
# TARGETS
number_slider_6 = Slider(50, range=1..500)
list_4 = FlagFields({"Shoulder": 1, "Elbow": 2, "Wrist": 4}, selected="Wrist")
list_5 = ValueList({"Joint", "Linear"}, selected="Joint")
speed_3 = CreateSpeed(
    Translation=number_slider_6,
    Rotation=3.141592654,
    ExternalTranslation=5000,
    ExternalRotation=18.84955592,
    AccelTranslation=2500,
    AccelAxis=12.56637061)
setdo_3 = SetDO(DO="0", Value=Toggle(True))
target_3 = CreateTarget(
    Plane=pflip_2,
    RobConf=list_4,
    Motion=list_5,
    Tool=tool.Tool,
    Speed=speed_3,
    Zone=Slider(0.5, range=0.01..5),
    Command=setdo_3,
    IsCartesian=True)

# ----
# CODE GENERATION
merge_3 = Merge(Data1=target, Data2=target_3, Data3=target_2)
program = CreateProgram(Name="DefaultProgram", RobotSystem=loadrobot, Targets=flatten(merge_3), StepSize=1)  # -> Program, Code, Duration, Warnings, Errors
sim = ProgramSimulation(Program=program.Program, Time=timer_0_1, Normalized=True)  # -> SystemMeshes, JointRotations, Plane, Index, Time, Program, Errors

# ----
# 5. BASIC PREVIEW
detarget = DeconstructTarget(Target=merge_3)  # -> Joints, Plane
split = SplitList(List=detarget.Plane, Index=sim.Index)  # -> ListA, ListB
pline_2 = PolyLine(Vertices=split.ListA, Closed=False)
toolpath = Curve(pline_2)

# ----
# PREVIEW ROBOTIC ARM MESH
alignvert = AlignVertices(Mesh=sim.SystemMeshes, Tolerance=0.001)  # -> Result, Count
preview = CustomPreview(Geometry=alignvert.Result, Material=ColourSwatch(SwatchColor=RGB(82, 82, 82)))

# ----
# PREVIEW TOOLPATH
swatch = ColourSwatch(SwatchColor=RGB(189, 189, 189))
previewlw = CustomPreviewLineweights(Geometry=toolpath, Shader=swatch, Thickness=Slider(4, range=0.01..100), Absolute=False)

# ----
# 3D MESH TOOLPATH PREVIEW
number_slider_7 = Slider(4, range=0..10)  # disabled
# 6. 3D MESH PREVIEW (DISABLED FOR SPEED)
number_slider_8 = Slider(20000, range=0..100000)  # disabled
div = DivideDomain(Domain=Domain(0, 1), Count=number_slider_8)  # disabled
Z_3 = UnitZ(Factor=layer_height_2)  # disabled
dedomain = DeconstructDomain(Domain=div)  # -> Start, End; disabled
paramextrmsh = ParameterExtrudeMesh(
    Profile=toolpath,
    Direction=Z_3,
    ParametersU=dedomain.Start,
    ParametersV=[0, 0.25, 0.5, 0.75, 1],
    Weighted=False,
    Lengths=False,
    Angle=0,
    Cap=False,
    Triangulate=False,
    WeightedV=False,
    LengthsV=False,
    AngleV=0)  # disabled
offmsh = OffsetMesh(Mesh=paramextrmsh, Distance=number_slider_7, BothSides=expr("x*-1", number_slider_7), CreateSolid=True)  # disabled
swatch_2 = ColourSwatch(SwatchColor=RGB(191, 191, 191))  # disabled
wbcatmullclark = WeaverbirdsCatmullClarkSubdivision(MeshCurves=offmsh, Level=1, SmoothNakedEdges=1)  # disabled
preview_2 = CustomPreview(Geometry=wbcatmullclark, Material=swatch_2)  # disabled

# ----
# NOOZLE LOCATION
number_slider_9 = Slider(300, range=0..1000)  # disabled
number_slider_10 = Slider(30, range=0..1000)  # disabled
geo = Geometry(sim.Plane)  # disabled
item_2 = ListItem(List=geo, Index=7, Wrap=True)  # disabled
Z_4 = UnitZ(Factor=number_slider_9)  # disabled
Z_5 = UnitZ(Factor=number_slider_10)  # disabled
pdecon = Deconstruct(Point=item_2)  # -> XComponent, YComponent, ZComponent; disabled
move_10 = Move(Geometry=item_2, Motion=Z_4)  # -> Geometry, Transform; disabled
pdecon_2 = Deconstruct(Point=move_10.Geometry)  # -> XComponent, YComponent, ZComponent; disabled
subtraction_2 = Subtraction(A=pdecon.YComponent, B=num)  # disabled
subtraction_3 = Subtraction(A=pdecon.XComponent, B=num_3)  # disabled
subtraction_4 = Subtraction(A=pdecon.ZComponent, B=num_2)  # disabled
round_2 = Round(Number=subtraction_2)  # -> Nearest, Floor, Ceiling; disabled
round_3 = Round(Number=subtraction_4)  # -> Nearest, Floor, Ceiling; disabled
round_4 = Round(Number=subtraction_3)  # -> Nearest, Floor, Ceiling; disabled
panel_4 = Panel(",")  # disabled
panel_5 = Panel("{ ")  # disabled
panel_6 = Panel(" }")  # disabled
move_11 = Move(Geometry=item_2, Motion=Z_4)  # -> Geometry, Transform; disabled
number_slider_11 = Slider(1000, range=0..10000)  # disabled
join_2 = TextJoin(Text=[round_4.Nearest, round_2.Nearest, round_3.Nearest], Join=panel_4)  # disabled
swatch_3 = ColourSwatch(SwatchColor=RGB(0, 0, 0))  # disabled
join_3 = TextJoin(Text=flatten([panel_5, join_2]))  # disabled
number_slider_12 = Slider(30, range=0..1000)  # disabled
number_slider_13 = Slider(2, range=0..10)  # disabled
join_4 = TextJoin(Text=flatten([join_3, panel_6]))  # disabled
pt = ConstructPoint(XCoordinate=pdecon_2.XComponent, YCoordinate=pdecon_2.YComponent, ZCoordinate=number_slider_11)  # disabled
move_12 = Move(Geometry=pt, Motion=expr("x*-1", Z_5))  # -> Geometry, Transform; disabled
ln_6 = Line(StartPoint=move_11.Geometry, EndPoint=move_12.Geometry)  # disabled
previewlw_2 = CustomPreviewLineweights(Geometry=ln_6, Shader=swatch_3, Thickness=number_slider_13, Absolute=False)  # disabled
screentext = ScreenOrientedText(Text=join_4, Font=panel_2, Justification=8, Location=pt, SizeFactor=number_slider_12, Depth=0, Absolute=False)  # disabled

# ----
# LAYER POSITION CHECK
pdecon_3 = Deconstruct(Point=flatten(divlength.Points))  # -> XComponent, YComponent, ZComponent; disabled
cset = CreateSet(List=pdecon_3.ZComponent)  # -> Set, Map; disabled
consec = ConsecutiveDomains(Numbers=cset.Set, Additive=False)  # disabled
lng = ListLength(List=consec)  # disabled
panel_7 = Panel("LAYER #: ")  # disabled
inc = Includes(Value=pdecon.ZComponent, Domain=consec)  # -> Includes, Deviation; disabled
series_2 = Series(Start=0, Step=1, Count=lng)  # disabled
cull_5 = CullPattern(List=series_2, CullPattern=inc.Includes)  # disabled
panel_8 = Panel("1")  # disabled
addition_2 = Addition(A=cull_5, B=panel_8)  # disabled
panel_9 = Panel(addition_2)  # disabled
join_5 = TextJoin(Text=flatten([panel_7, panel_9]))  # disabled

# ----
# PROGRESS CHECK
division_2 = Division(A=sim.Time, B=program.Duration)  # disabled
number_slider_14 = Slider(100, range=0..100)  # disabled
panel_10 = Panel("100")  # disabled
panel_11 = Panel("%")  # disabled
multiplication = Multiplication(A=division_2, B=panel_10)  # disabled
round_5 = Round(A=multiplication, num=number_slider_14)  # disabled
panel_12 = Panel("PROGRESS: ")  # disabled
join_6 = TextJoin(Text=flatten([round_5, panel_11]))  # disabled
join_7 = TextJoin(Text=flatten([panel_12, join_6]))  # disabled
panel_13 = Panel("")  # disabled
join_8 = TextJoin(Text=flatten([join_7, join_5]), Join=panel_13)  # disabled

# ----
# LENGTH & VOLUME CHECK
volume_4 = MeshVolume(Mesh=offmsh)  # -> expr("x*0.001", Volume), Centroid; disabled
len_2 = Length(Curve=toolpath)  # -> expr("x/10", Length); disabled
round_6 = Round(Number=volume_4.Volume)  # -> Nearest, Floor, Ceiling; disabled
round_7 = Round(Number=len_2)  # -> Nearest, Floor, Ceiling; disabled
panel_14 = Panel("VOLUME [TOTAL]: ")  # disabled
panel_15 = Panel(round_7.Nearest)  # disabled
panel_16 = Panel("LENGTH [TOTAL]: ")  # disabled
panel_17 = Panel(round_6.Nearest)  # disabled
panel_18 = Panel("cm3")  # disabled
panel_19 = Panel("cm")  # disabled
concat = Concatenate(FragmentA=panel_17, FragmentB=panel_18)  # disabled
concat_2 = Concatenate(FragmentA=panel_15, FragmentB=panel_19)  # disabled
concat_3 = Concatenate(FragmentA=panel_14, FragmentB=concat)  # disabled
concat_4 = Concatenate(FragmentA=panel_16, FragmentB=concat_2)  # disabled
join_9 = TextJoin(Text=flatten([concat_3, concat_4]), Join=panel_13)  # disabled

# ----
# TEXT TO SCREEN
number_slider_15 = Slider(230, range=0..1000)  # disabled
number_slider_16 = Slider(650, range=0..1000)  # disabled
number_slider_17 = Slider(124, range=0..1000)  # disabled
number_slider_18 = Slider(30, range=0..100)  # disabled
pt_2 = ConstructPoint(XCoordinate=number_slider_16, YCoordinate=number_slider_17, ZCoordinate=0)  # disabled
pt_3 = ConstructPoint(XCoordinate=number_slider_16, YCoordinate=number_slider_15, ZCoordinate=0)  # disabled
texttoscreen = RenderTextToScreen(Text=join_9, Location=pt_3, Size=number_slider_18, Color=RGB(0, 0, 0), Font=panel_2, m_scWithvp=False)  # disabled
texttoscreen_2 = RenderTextToScreen(Text=join_8, Location=pt_2, Size=number_slider_18, Color=RGB(0, 0, 0), Font=panel_2, m_scWithvp=False)  # disabled

# ==== cluster Round
num = ClusterInput()
A = ClusterInput()
num_2 = Number(num)

multiplication = Multiplication(A=A, B=num_2)
round = Round(Number=multiplication)  # -> Nearest, Floor, Ceiling
division = Division(A=round.Nearest, B=num_2)

R = ClusterOutput(division)
